# Grasshopper definition CircleSpaceAnalysis.gh (Grasshopper 1.0.7)
# plug-ins: ClipperComponents, Nautilus

# ---- group: defining the space to create circles in
sheet = Surface(<surface referenced from the Rhino model>)
parts = Surface([<surface referenced from the Rhino model> x3])
project = Project(Geometry=parts, Plane=sheet)  # -> Geometry, Transform
edges = BrepEdges(Brep=project.Geometry)  # -> Naked, Interior, NonManifold
edges_2 = BrepEdges(Brep=sheet)  # -> Naked, Interior, NonManifold
join = JoinCurves(Curves=edges_2.Naked, Preserve=False)
join_2 = JoinCurves(Curves=edges.Naked, Preserve=False)
polyoffset = PolylineOffset(
    Polylines=graft([join, join_2]),
    Distance="1",
    Plane=Plane(origin=(0, 0, 0), x=(0, 0, 0), y=(0, 0, 0)),
    Tolerance=1e-05,
    ClosedFillet=1,
    OpenFillet=1,
    Miter=2)  # -> Contour, Holes

# ---- group: drawing the circles from delaunay
crv = Curve(polyoffset.Holes)
divide = DivideCurve(Curve=crv, Count=Slider(500, range=0..1000), Kinks=False)  # -> Points, Tangents, Parameters
del = DelaunayMesh(Points=flatten(divide.Points), Plane=crv)
facec = FaceCircles(Mesh=del)  # -> Centers, Ratio
point = Point(facec.Centers)
point_in_curves = PointInCurves(Point=point, Curves=flatten(join_2))  # -> Relationship, Index, Point
division = Division(A=point_in_curves.Relationship, B=Slider(2, range=0..10))
cull_pattern = CullPattern(List=facec.Centers, CullPattern=invert(division))
darc = DeconstructArc(Arc=cull_pattern)  # -> simplify(BasePlane), Radius, Angle
incurve = PointInCurve(Point=darc.BasePlane, Curve=crv)  # -> Relationship, Point
cull = CullPattern(List=cull_pattern, CullPattern=incurve.Relationship)

# ---- group: extract non overlapping circles
remove_overlapping_circles = RemoveOverlappingCircles(Circles=cull, SortCircles="-1", Tolerance=Slider(1, range=0..1))
panel = Panel(remove_overlapping_circles)
