# Grasshopper definition PentagonalTruchetGenerator.gh (Grasshopper 1.0.7)
# plug-ins: Parakeet

geometry = Geometry([<curve referenced from the Rhino model> x64])
pattern_genotype_a = PatternGenotypeA(BasePolylines=geometry, Factor=0.5)
pattern_genotype_c = PatternGenotypeC(BasePolylines=geometry, Factor=0.5)
pattern_genotype_l_pt = PatternGenotypeLPT(BasePolylines=geometry, RotationFactor=0.05, ScaleFactor=0.8)
pattern_genotype_o = PatternGenotypeO(
    BasePolylines=geometry,
    Orientation=Slider(1, range=0..1),
    Prune=Slider(1, range=0..1),
    SelfIntersection=Slider(1, range=0..1),
    StepNumber=Slider(2, range=0..10),
    BulgeFactor=Slider(0.23, range=0..10),
    Degree=Slider(2, range=0..3),
    Seed=Slider(7, range=0..10))  # -> Pattern, LinearPattern
